# Grasshopper definition THERM_Export_Workflow.gh (Grasshopper 1.0.7)

honeybee = Honeybee_Honeybee()  # -> Vviiiiiiiiiizzz; plug-in component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
ladybug = Ladybug_Ladybug()  # -> Vviiiiiiiiiizzz; plug-in component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

interiorboundary = Curve(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)
# 2) Define THERM Boundary Conditions
# with Temperatures and U-Factor Tags
exteriorboundary = Curve(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)
list = ValueList({"indoor", "outdoor"}, selected="indoor")
list_2 = ValueList({"indoor", "outdoor"}, selected="outdoor")
createthermboundaries = Honeybee_CreateThermBoundaries(boundaryCurve=interiorboundary, name="Interior", temperature="20", filmCoefficient=list, uFactorTag="IntWall")  # -> readMe, simplify(thermBoundary); plug-in component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
createthermboundaries_2 = Honeybee_CreateThermBoundaries(boundaryCurve=exteriorboundary, name="Exterior", temperature="-18", filmCoefficient=list_2)  # -> readMe, simplify(thermBoundary); plug-in component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

# ----
# CREATE A THERM MODEL
# 1) Define THERM Polygons With Materials
gypsum = Geometry(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)
air_gap = Geometry(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)
steelstuds = Geometry([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])
insulation = Geometry([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])
plywood = Geometry(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)
brick = Geometry(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)
createthermpolygons = Honeybee_CreateThermPolygons(geometry=plywood, material="G05 25MM WOOD")  # -> readMe, simplify(thermPolygon); plug-in component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
createthermpolygons_2 = Honeybee_CreateThermPolygons(geometry=gypsum, material="1/2IN GYPSUM")  # -> readMe, simplify(thermPolygon); plug-in component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
createthermpolygons_3 = Honeybee_CreateThermPolygons(geometry=insulation, material="CELLULOSE, CELLULOSIC FIBER, COTTON FIBER")  # -> readMe, simplify(thermPolygon); plug-in component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
createthermpolygons_4 = Honeybee_CreateThermPolygons(geometry=brick, material="M01 100MM BRICK")  # -> readMe, simplify(thermPolygon); plug-in component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
createthermpolygons_5 = Honeybee_CreateThermPolygons(geometry=air_gap, material="FRAME CAVITY SLIGHTLY VENTILATED NFRC 100")  # -> readMe, simplify(thermPolygon); plug-in component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
createthermpolygons_6 = Honeybee_CreateThermPolygons(geometry=steelstuds, material="STEEL - STAINLESS (BUFFED)")  # -> readMe, simplify(thermPolygon); plug-in component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

# ----
# 3) Write the Polygons +
# Boundaries into a THERM XML File
toggle = BooleanToggle(False)
geo = Geometry(flatten([createthermpolygons_4.thermPolygon, createthermpolygons_3.thermPolygon, createthermpolygons_2.thermPolygon, createthermpolygons.thermPolygon, createthermpolygons_6.thermPolygon, createthermpolygons_5.thermPolygon]))

writetherm = Honeybee_WriteTHERMFile(
    polygons=flatten(geo),
    boundaries=flatten([createthermboundaries_2.thermBoundary, createthermboundaries.thermBoundary]),
    fileName="thermWallStud",
    writeTHMFile=toggle,
    runTHERM=toggle)  # -> readMe, thermFile, resultFile, uFactorFile, port, probRegion; plug-in component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

edges = BrepEdges(Brep=geo)  # -> Naked, Interior, NonManifold
preview = CustomPreview(Geometry=edges.Naked, Shader=ColourSwatch(SwatchColor=RGB(0, 0, 0)))

xml_file_that_can_be_opened_in_therm = Panel(writetherm.readMe)

# ----
# 5) Customize the graphics
# with LegendPar
colorscheme = Slider(2, range=0..23)
gradientlibrary = Ladybug_GradientLibrary(gradIndex=colorscheme)  # -> customColors; plug-in component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
legendpar = Ladybug_LegendParameters(lowBound="-20", highBound="20", customColors=flatten(gradientlibrary), decimalPlaces="1", removeLessThan=Toggle(True))  # -> legendPar; plug-in component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

# ----
# 4) Import your results!!
toggle_2 = BooleanToggle(True)

readtherm = Honeybee_ReadTHERMResult(resultFile=writetherm.resultFile, uFactorFile=writetherm.uFactorFile, legendPar=legendpar, runIt=toggle_2)  # -> uFactorTags, uFactors, uFactorLength, deltaT, meshValues, meshPoints, coloredMesh, legend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; plug-in component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
# Use Thermally-Bridged U-Values to
# Inform Your EnergyPlus Simulations!
u_factor_tags = Panel(readtherm.uFactorTags)
# Dive Deep Into the
# Mesh Point Data!
temperatures = Panel(readtherm.meshValues)
u_factors = Panel(readtherm.uFactors)

# ----
# EXPLORE MATERIALS
# Use Materials from Either the THERM or EnergyPlus Libraries
callfromepconstrlibrary = Honeybee_CallFromEPConstructionLibrary()  # -> ThermMaterials, EPMaterials, EPWindowMaterials, EPConstructions; plug-in component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
therm_materials = Panel(callfromepconstrlibrary.ThermMaterials)
energyplus_materials = Panel(callfromepconstrlibrary.EPMaterials)
energyplus_window_materials = Panel(callfromepconstrlibrary.EPWindowMaterials)

# ----
# ... Or Create Your Own Materials
panel = Panel("AdobeBrick")
epopaquemat = Honeybee_EnergyPlusOpaqueMaterial(name=panel, thickness="0.5", conductivity="1.73", density="2243", specificHeat="837", solAbsp="0.5", visAbsp="0.5")  # -> EPMaterial; plug-in component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
thermmaterial = Honeybee_ThermMaterial(materialName="Aerogel", conductivity="0.03")  # -> thermMaterial; plug-in component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

# ----
# Look Up Properties of Materials
panel_2 = Panel("FOAM GLASS")
# Any Material can just be connected up
# to the '_material' input of the
# createThermPolygons Component
panel_3 = Panel("8IN CONCRETE HW")
decomposeepmaterial = Honeybee_DecomposeEPMaterial(materialName=simplify(panel_2))  # -> names, values, comments, UValue_SI, UValue_IP, RValue_SI, RValue_IP; plug-in component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
decomposeepmaterial_2 = Honeybee_DecomposeEPMaterial(materialName=simplify(panel_3))  # -> names, values, comments, UValue_SI, UValue_IP, RValue_SI, RValue_IP; plug-in component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
panel_4 = Panel(decomposeepmaterial.values)
panel_5 = Panel(decomposeepmaterial_2.values)
panel_6 = Panel(decomposeepmaterial.comments)
panel_7 = Panel(decomposeepmaterial_2.comments)
